# Dynamo graph FriendshipGraph.dyn (Dynamo 0.8.2.2106)

# group: People List
code_block = CodeBlock { "Ben"; "Randy"; "Jun"; "Aparajit"; "EB"; "Ritesh"; "Monika"; "Sharad"; "Minh"; "Zora"; "Yu Ke"; }
create = List.Create(code_block.out0, code_block.out1, code_block.out2, code_block.out3, code_block.out4, code_block.out5, code_block.out6, code_block.out7, code_block.out8, code_block.out9, code_block.out10)
shuffle = List.Shuffle(create)
join = List.Join(create, shuffle)
shuffle_2 = List.Shuffle(join)

code_block_2 = CodeBlock()
# ---------- code_block_2.designscript (2 lines) ----------
//Equal weight;
1;
# ----------------------------------------
code_block_3 = CodeBlock { null; }
connectObjects = DynamoGraph.Connector.ConnectObjects(join, shuffle_2, code_block_2, code_block_3)
fromConnectors = DynamoGraph.Graph.FromConnectors(connectObjects)
integer_slider = IntegerSlider(0, range=0..10 step 1)
getItemAtIndex = List.GetItemAtIndex(list=create, index=integer_slider)
integer_slider_2 = IntegerSlider(8, range=0..10 step 1)
getItemAtIndex_2 = List.GetItemAtIndex(list=create, index=integer_slider_2)
boolean = BoolSelector(false)
getShortestPath = DynamoGraph.Graph.GetShortestPath(fromConnectors, getItemAtIndex, getItemAtIndex_2, boolean)
adjacentConnectors = DynamoGraph.Graph.AdjacentConnectors(fromConnectors, getItemAtIndex)
adjacentConnectors_2 = DynamoGraph.Graph.AdjacentConnectors(fromConnectors, getItemAtIndex_2)
vertices = DynamoGraph.Graph.Vertices(fromConnectors)
