# Dynamo graph ShortestDistance.dyn (Dynamo 0.8.2.2021)

code_block = CodeBlock { 10; }

# group: Random list of Points
randomList = Math.RandomList(code_block)
mul = randomList * code_block
randomList_2 = Math.RandomList(code_block)
mul_2 = code_block * randomList_2
randomList_3 = Math.RandomList(code_block)
mul_3 = code_block * randomList_3
byCoordinates = Point.ByCoordinates(x=mul, y=mul_2, z=mul_3)

integer_slider = IntegerSlider(2, range=0..9 step 1)

# group: Shortest Path using Curves
byPoints = Tessellation.Delaunay.ByPoints(byCoordinates)
code_block_2 = CodeBlock(a=byCoordinates) { a[0]; a[1]; }
getItemAtIndex = List.GetItemAtIndex(list=byCoordinates, index=integer_slider)
getShortestPath = DynamoGraph.Algorithms.GetShortestPath(byPoints, code_block_2.out1, getItemAtIndex)

# group: Indices in randomized order
code_block_3 = CodeBlock(n=code_block) { 0..(n-1); }
shuffle = List.Shuffle(code_block_3)
shuffle_2 = List.Shuffle(code_block_3)
join = List.Join(shuffle, shuffle_2)
shuffle_3 = List.Shuffle(join)

# group: Shortest Path using generic connectors
getItemAtIndex_2 = List.GetItemAtIndex(list=byCoordinates, index=join)
getItemAtIndex_3 = List.GetItemAtIndex(list=byCoordinates, index=shuffle_3)
distanceTo = Geometry.DistanceTo(geometry=getItemAtIndex_2, other=getItemAtIndex_3)

byStartPointEndPoint = Line.ByStartPointEndPoint(startPoint=getItemAtIndex_2, endPoint=getItemAtIndex_3)

# group (continued): Shortest Path using generic connectors
connectObjects = DynamoGraph.Connector.ConnectObjects(getItemAtIndex_2, getItemAtIndex_3, distanceTo, byStartPointEndPoint)
getShortestPath_2 = DynamoGraph.Algorithms.GetShortestPath(connectObjects, code_block_2.out0, getItemAtIndex)

byPoints_2 = PolyCurve.ByPoints(points=getShortestPath_2)
