# Dynamo graph ShortestPath.dyn (Dynamo 0.8.2.2106)

select_model_elements = DSModelElementsSelection()  # 15 picked in the model
geometry = Element.Geometry(select_model_elements)
flatten = Flatten(geometry)
fromCurves = DynamoGraph.Graph.FromCurves(flatten)
vertices = DynamoGraph.Graph.Vertices(fromCurves)
integer_slider = IntegerSlider(0, range=0..30 step 1)
getItemAtIndex = List.GetItemAtIndex(list=vertices, index=integer_slider)
integer_slider_2 = IntegerSlider(8, range=0..30 step 1)
getItemAtIndex_2 = List.GetItemAtIndex(list=vertices, index=integer_slider_2)
boolean = BoolSelector(false)
getShortestPath = DynamoGraph.Graph.GetShortestPath(fromCurves, getItemAtIndex, getItemAtIndex_2, boolean)
